# Grasshopper definition workflow.gh (Grasshopper 1.0.4)

python = GhPythonScript()  # -> out, cd
# ---------- python: Python ----------
__author__ = "ytakzk"
__version__ = "2018.12.04"

path = ghenv.Component.OnPingDocument().FilePath

separator = '/'
split = path.split(separator)

if len(split) < 2:
    separator = '\\'
    split = path.split(separator)

cd = separator.join(split[:-1]) + separator
# ---------- end python ----------
panel = Panel(python.cd)
# Run a server
python_2 = GhPythonScript(python="C:\tools\Anaconda2\envs\python36\python.exe", cd=python.cd, port="9999")  # -> out; inputs port: Int32
# ---------- python_2: Python ----------
__author__ = "ytakzk"
__version__ = "2018.12.04"

import os
import threading
import urllib2

endpoint = 'http://localhost:%d' % (port)

try:
    
    urllib2.urlopen(endpoint)
    print('The server is already running')

except:
    
    print('Run a server')
    
    def run():
        
        command = 'cd %s && %s app.py -port %d' % (cd, python, port) 
        print(command)
        os.system(command)
    
    t = threading.Thread(target=run)
    t.start()

running = 1
# ---------- end python_2 ----------
# Model selecion
model_selecion = GhPythonScript(port="9999", index=Slider(10, range=0..8500), run=Button())  # -> succeeded; inputs port: Int32, index: Int32
# ---------- model_selecion: Python ----------
__author__ = "ytakzk"
__version__ = "2018.12.04"

import urllib2

if run:
    
    endpoint = 'http://localhost:%d/fetch_data/%d' % (port, index)
    print(endpoint)
    succeeded = urllib2.urlopen(endpoint).read()

else:
    succeeded = False
# ---------- end model_selecion ----------
panel_2 = Panel(python_2)
# Manipulation
manipulation = GhPythonScript(port="9999", succeeded=model_selecion)  # -> succeeded; inputs port: Int32, succeeded: Boolean
# ---------- manipulation: Python ----------
__author__ = "ytakzk"
__version__ = "2018.12.04"

import urllib2

if succeeded:
    
    endpoint = 'http://localhost:%d/manipulate' % (port)
    succeeded = urllib2.urlopen(endpoint).read()
# ---------- end manipulation ----------
# Pointcloud to Mesh
pointcloud_to_mesh = GhPythonScript(port="9999", succeeded=manipulation)  # -> succeeded; inputs port: Int32, succeeded: Boolean
# ---------- pointcloud_to_mesh: Python ----------
__author__ = "ytakzk"
__version__ = "2018.12.04"

import urllib2

endpoint = 'http://localhost:%d/generate_mesh' % (port)

succeeded = urllib2.urlopen(endpoint).read()
# ---------- end pointcloud_to_mesh ----------
# Mesh Visualization
mesh_visualization = GhPythonScript(cd=python.cd, succeeded=pointcloud_to_mesh)  # -> mesh; inputs succeeded: Boolean
# ---------- mesh_visualization: Python ----------
__author__ = "ytakzk"
__version__ = "2018.12.04"

import rhinoscriptsyntax as rs
import Rhino.Geometry as rg

path = cd + '/pointcloud2mesh/mount/output.off'

with open(path, 'r') as file:
    
    vertices = []
    faces = []
    
    for i, l in enumerate(file):
        
        if i < 2:
            continue
            
        vals = l.split(' ')
        
        if len(vals) == 3:
            vals = [float(v) for v in vals]
            vertices.append(vals)
        elif len(vals) == 4:
            vals = [int(v) for v in vals[1:]]
            faces.append(vals)
            
    mesh = rs.AddMesh(vertices, faces)
# ---------- end mesh_visualization ----------
mesh = Mesh(mesh_visualization)
